# Dynamo graph fields.dyn (Dynamo 1.3.0.875)

code_block = CodeBlock { "AF"; }
fileType = BS1192.Fields.FileType.FileType(code_block)
currentFileType = BS1192.Fields.FileType.CurrentFileType(fileType)
revision = BS1192.Fields.Revision.Revision()
getAsString = BS1192.Fields.Revision.GetAsString(revision)
revision_2 = BS1192.Fields.Revision.Revision()
incrementMinor = BS1192.Fields.Revision.IncrementMinor(revision_2)
code_block_2 = CodeBlock { 7; }
setMajor = BS1192.Fields.Revision.SetMajor(incrementMinor, code_block_2)
getAsString_2 = BS1192.Fields.Revision.GetAsString(setMajor)
setMinor = BS1192.Fields.Revision.SetMinor(incrementMinor, code_block_2)
incrementMinor_2 = BS1192.Fields.Revision.IncrementMinor(setMinor)
MR = BS1192.Standard.FileTypes.MR()
